# Grasshopper definition Update_Datadam.gh (Grasshopper 1.0.7)
# Copyright: 2021

# ---- group: simple counter
c_script = CSharpScript(run=Button(), reset=Button())  # -> count; inputs run: Boolean, reset: Boolean
# ---------- c_script: C# ----------
    if (run)
      counter++;
    count = counter;

    if(reset)
      counter = 0;
# ---------- c_script: C# additional code ----------
  int counter = 47;
# ---------- end c_script ----------

# ----
# name of all the groups
# to update dams in.
panel = Panel("dams")
check = CSharpScript(groupNames=flatten(panel), run=Button())  # -> out; inputs groupNames: list of String, run: Boolean
# ---------- check: C# usings ----------
using System.Linq;
using System.Drawing;
# ---------- check: C# ----------
    if (run) 
    {
      
      foreach (var groupName in groupNames)
      {
        ExpireDams(groupName);
      }
    }
# ---------- check: C# additional code ----------
  void ExpireDams(string groupName){


    var groups = GrasshopperDocument.Objects.OfType<Grasshopper.Kernel.Special.GH_Group>();

    var keyGroup = groups.Where(g => g.NickName == groupName);

    foreach (var myGroup in keyGroup)
    {


      var objects = myGroup.Objects();
      foreach (var obj in objects)
      {
        Grasshopper.Kernel.Components.GH_DataDamComponent myDam = obj as Grasshopper.Kernel.Components.GH_DataDamComponent;
        myDam.ExpireSolution(true);
        Print(obj.GetType().ToString());
      }

    }




  }
# ---------- end check ----------

panel_2 = Panel(check)

# ---- group: dams
dam = DataDam(DataA=c_script, BufferDelay=10000000, BufferMode=0)

dam_2 = DataDam(DataA=c_script, BufferDelay=10000000, BufferMode=0)

# ----
panel_3 = Panel(dam)
panel_4 = Panel(dam_2)
